# Grasshopper definition Test.ghx (Grasshopper 0.9.50)
# Copyright: Angel Linares || 2013

vb = VBScript()  # -> out, A; inputs x: list of Brep
# ---------- vb: C# ----------
    
    A = Rhino.Geometry.Brep.CreateSolid(x, 0.01)
# ---------- end vb ----------
